% Requirement links of HighLevelReqs.slreqx (R2022a)

#10 refines SystemReqs.slreqx#10: SR_6: Attitude Rate Tracking Performance
#10 refines SystemReqs.slreqx#11: SR_7: Control Bandwidth
#10 refines SystemReqs.slreqx#12: SR_8: Control Gain and Phase Margins
#11 refines SystemReqs.slreqx#10: SR_6: Attitude Rate Tracking Performance
#11 refines SystemReqs.slreqx#11: SR_7: Control Bandwidth
#11 refines SystemReqs.slreqx#12: SR_8: Control Gain and Phase Margins
#12 refines SystemReqs.slreqx#10: SR_6: Attitude Rate Tracking Performance
#12 refines SystemReqs.slreqx#11: SR_7: Control Bandwidth
#12 refines SystemReqs.slreqx#12: SR_8: Control Gain and Phase Margins
#13 refines SystemReqs.slreqx#14: SR_10: Sensor Validation
#14 refines SystemReqs.slreqx#9: SR_5: Attitude Heading Reference System Interfaces
#15 refines SystemReqs.slreqx#15: SR_11: Sensor Voting
#16 refines SystemReqs.slreqx#15: SR_11: Sensor Voting
#17 refines SystemReqs.slreqx#15: SR_11: Sensor Voting
#18 refines SystemReqs.slreqx#15: SR_11: Sensor Voting
#5 refines SystemReqs.slreqx#5: SR_1: Pilot Input Signals
#5 refines SystemReqs.slreqx#13: SR_9: Attitude Rate Authority Limiting
#6 refines SystemReqs.slreqx#6: SR_2: Hydraulic Actuator Interfaces
#6 refines SystemReqs.slreqx#7: SR_3: Hydraulic Actuator Signals
#7 refines SystemReqs.slreqx#6: SR_2: Hydraulic Actuator Interfaces
#7 refines SystemReqs.slreqx#7: SR_3: Hydraulic Actuator Signals
#8 refines SystemReqs.slreqx#8: SR_4: Hydraulic Actuator Control Loop Performance
#9 refines SystemReqs.slreqx#10: SR_6: Attitude Rate Tracking Performance
#9 refines SystemReqs.slreqx#11: SR_7: Control Bandwidth
#9 refines SystemReqs.slreqx#12: SR_8: Control Gain and Phase Margins