test file "AHRS_Voter_REQ_Based_Test"
  coverage: Decision, MCDC, SignalRange, SimulinkDesignVerifier, RelationalBoundary, Condition, LookupTable, SaturationOnIntOverflow

suite "REQ-Based Test"

  case "HLR_11" [simulation]
    description: Simulation test for HLR_11 AHRS Voting for Triple Sensors.
    model AHRS_Voter, harness AHRS_Voter_Harness_HLR_11

  case "HLR_12" [simulation]
    description: Simulation test for HLR_12 AHRS Voting for Dual Sensors.
    model AHRS_Voter, harness AHRS_Voter_Harness_HLR_12

  case "HLR_13" [simulation]
    description: Simulation test for HLR_13 AHRS Usage of Single Sensor.
    model AHRS_Voter, harness AHRS_Voter_Harness_HLR_13