test file "OuterLoop_Control_REQ_Based_Test"
  coverage: Decision, MCDC, SignalRange, SimulinkDesignVerifier, RelationalBoundary, Condition, LookupTable, SaturationOnIntOverflow

suite "REQ-Based Test"

  case "HLR_6" [baseline]
    description: SIL test for HLR_6 Pitch Outer Loop Control.
    model OuterLoop_Control, harness OuterLoop_Control_Harness_HLR_6
    input "StepUp" from HLR_6_Input_Data.xlsx, mapped to PitchCmd, RollCmd, YawRateCmd, AHRSData (active)
    input "StepDown" from HLR_6_Input_Data.xlsx, mapped to PitchCmd, RollCmd, YawRateCmd, AHRSData
    baseline "StepUp"
      PitchCorr:1
      RollCorr:1
      YawRateCorr:1
    baseline "StepDown"
      PitchCorr:1
      RollCorr:1
      YawRateCorr:1
    iterations:
      Iteration1: ExternalInput "StepUp", Baseline "StepUp"
      Iteration2: ExternalInput "StepDown", Baseline "StepDown"

  case "HLR_7" [baseline]
    description: SIL test for HLR_7 Roll Outer Loop Control.
    model OuterLoop_Control, harness OuterLoop_Control_Harness_HLR_7
    input "StepUp" from HLR_7_Input_Data.xlsx, mapped to PitchCmd, RollCmd, YawRateCmd, AHRSData (active)
    input "StepDown" from HLR_7_Input_Data.xlsx, mapped to PitchCmd, RollCmd, YawRateCmd, AHRSData
    baseline "StepUp"
      PitchCorr:1
      RollCorr:1
      YawRateCorr:1
    baseline "StepDown"
      PitchCorr:1
      RollCorr:1
      YawRateCorr:1
    iterations:
      Iteration1: ExternalInput "StepUp", Baseline "StepUp"
      Iteration2: ExternalInput "StepDown", Baseline "StepDown"

  case "HLR_8" [baseline]
    description: SIL test for HLR_8 Yaw Rate Outer Loop Control.
    model OuterLoop_Control, harness OuterLoop_Control_Harness_HLR_8
    input "StepUp" from HLR_8_Input_Data.xlsx, mapped to PitchCmd, RollCmd, YawRateCmd, AHRSData (active)
    input "StepDown" from HLR_8_Input_Data.xlsx, mapped to PitchCmd, RollCmd, YawRateCmd, AHRSData
    baseline "StepUp"
      PitchCorr:1
      RollCorr:1
      YawRateCorr:1
    baseline "StepDown"
      PitchCorr:1
      RollCorr:1
      YawRateCorr:1
    iterations:
      Iteration1: ExternalInput "StepUp", Baseline "StepUp"
      Iteration2: ExternalInput "StepDown", Baseline "StepDown"